# Grasshopper definition MODEL_PREDICTION TO GH.gh (Grasshopper 1.0.7)

# ----
# CSV
panel = Panel("C:\Users\pabli\Documents\GitHub\DG-AI_DF_Base\DGAI_Rhino\TESTS\Test_05.csv")
c_script = CSharpScript(csvFile=panel)  # -> out, pointsBlack, pointsRed; inputs csvFile: String
# ---------- c_script: C# ----------
    // Atribuindo a execução das funções às saídas dos nós
    pointsBlack = DiscriminatePointsCSV(csvFile, "Black");
    pointsRed = DiscriminatePointsCSV(csvFile, "Red");
# ---------- c_script: C# additional code ----------
  // Criação de pontos 3d
  Point3d CreatePoints(int x, int y, int z)
  {
    Point3d points = new Point3d(x, y, z);
    return points;
  }

  // Função que lê o arquivo .csv, o separa em linhas e em colunas e verifica sua condição
  List<Point3d> DiscriminatePointsCSV(string file, string condition)
  {
    // Leitura de linhas
    string[] csvLines = System.IO.File.ReadAllLines(file);

    var points = new List<Point3d>();

    // Para cada linha
    for (int i = 0; i < csvLines.Length; i++)
    {
      // Cada coluna será separada pela vírcula
      string[] rowData = csvLines[i].Split(',');

      // Atribuição de cada parâmetro à cada coluna
      string csvCondition = rowData[3];
      int x = Convert.ToInt32(rowData[0]);
      int y = Convert.ToInt32(rowData[2]);
      int z = Convert.ToInt32(rowData[1]);

      /* Se a condição for igual à verificada na chamada da função,
      então criamos pontos para todos que obedecem à essa igualdade */
      if (csvCondition.Contains(condition))
      {
        // Chamando função de criar pontos
        Point3d point = CreatePoints(x, y, z);
        points.Add(point);
      }
    }
    return points;
  }
# ---------- end c_script ----------
pt = Point(c_script.pointsBlack)
pt_2 = Point(c_script.pointsRed)

data = Data("C:\Users\pabli\Documents\GitHub\DG-AI_DF_Base\DGAI_Rhino\TESTS\Test_02.csv")
# HOLA IRENE INTERNALICE LOS CSV PARA QUE FUNCIONE EL SCRIPT DIRECTAMENTE. EN CASO QUE NO SE TE ABRA SOLO COPIA EN UN PANEL EL PATH CUANDO LO GUARDES EN TU COMPU COMO EL QUE ESTA A LADO DEL C#
data_2 = Data("C:\Users\pabli\Documents\GitHub\DG-AI_DF_Base\DGAI_Rhino\TESTS\Test_01.csv")

panel_2 = Panel("""0
2
5
7""")  # disabled
c_script_2 = CSharpScript(pointList=c_script.pointsRed, heightList=panel_2)  # -> out, simplify(points); inputs pointList: list of Point3d, heightList: Int32; disabled
# ---------- c_script_2: C# usings ----------
// Recursos de consulta em C#
using System.Linq;
# ---------- c_script_2: C# ----------
    // Criando uma lista de pontos para executar as funções
    List<Point3d> levelPoints = new List<Point3d>();

    // Atribuindo a execução da função à lista de pontos definida
    levelPoints = BordersByLevel(pointList, heightList);
    // Eliminando pontos duplicados (lista de pontos, tolerância)
    points = Point3d.CullDuplicates(levelPoints, 0);
# ---------- c_script_2: C# additional code ----------
  // Função que planifica pontos acima de uma altura e pega apenas os pontos de borda
  List<Point3d> BordersByLevel(List<Point3d> points, int height)
  {
    // Pegando todos os pontos acima da altura selecionada e colocando-os em uma lista
    var levelPoints = points.Where(p => p.Z >= height);
    var curve = levelPoints.Select(p => new Point3d(p.X, p.Y, height)).Distinct().ToList();

    // Agrupando pontos por X e por Y
    var groupsX = curve.GroupBy(p => p.X).ToDictionary(g => g.Key, g => g.ToList());
    var groupsY = curve.GroupBy(p => p.Y).ToDictionary(g => g.Key, g => g.ToList());

    List<Point3d> border = new List<Point3d>();

    /* Verificando a existência de pontos vizinhos no agrupamento em X
    para descobrir se é um ponto de borda ou não */
    foreach (var group in groupsX)
    {
      var list = group.Value;
      var ordered = list.OrderBy(p => p.Y).ToArray();
      for (int j = 0; j < ordered.Length; j++)
      {
        var current = ordered[j];
        Point3d next;
        Point3d previous;
        if (j - 1 >= 0)
        {
          previous = ordered[j - 1];
          if (current.Y - previous.Y == 1)
          {
            if (j + 1 < ordered.Length)
            {
              next = ordered[j + 1];
              if (next.Y - current.Y != 1)
              {
                border.Add(current);
              }
            }
            else border.Add(current);
          }
          else
          {
            border.Add(current);
          }
        }
        else border.Add(current);
      }
    }

    /* Verificando a existência de pontos vizinhos no agrupamento em Y
    para descobrir se é um ponto de borda ou não */
    foreach (var group in groupsY)
    {
      var list = group.Value;
      var ordered = list.OrderBy(p => p.X).ToArray();
      for (int j = 0; j < ordered.Length; j++)
      {
        var current = ordered[j];
        Point3d next;
        Point3d previous;
        if (j - 1 >= 0)
        {
          previous = ordered[j - 1];
          if (current.X - previous.X == 1)
          {
            if (j + 1 < ordered.Length)
            {
              next = ordered[j + 1];
              if (next.X - current.X != 1)
              {
                border.Add(current);
              }
            }
            else border.Add(current);
          }
          else
          {
            border.Add(current);
          }
        }
        else border.Add(current);
      }
    }

    // Retornando todos os pontos de borda
    return border;
  }
# ---------- end c_script_2 ----------
viewer = ParamViewer(c_script_2.points)  # disabled

# ----
# Context
number_slider = Slider(1, range=0..1)
box = DomainBox(Base=pt, X=number_slider, Y=number_slider, Z=number_slider)

# ----
# Prediction
number_slider_2 = Slider(1, range=0..1)
box_2 = DomainBox(Base=pt_2, X=number_slider_2, Y=number_slider_2, Z=number_slider_2)

custom_preview = CustomPreview(Geometry=box_2, Material=ColourSwatch(SwatchColor=RGB(148, 255, 241)))
custom_preview_2 = CustomPreview(Geometry=box, Material=ColourSwatch(SwatchColor=RGB(42, 69, 65)))
